# Grasshopper definition 1024_test.gh (Grasshopper 1.0.7)
# plug-ins: VolumeGeneratorBasedOnGraph

point = Point([Point(-135.4490472, 133.6098246, 0), Point(-147.9003699, 114.4173399, 0), Point(-121.3322609, 115.5276489, 0)])
point_2 = Point([Point(-137.1369182, 155.4221792, 0), Point(-163.1032157, 136.7682298, 0), Point(-162.3570578, 106.474216, 0), Point(-129.6753384, 90.95413009, 0), Point(-108.9321467, 110.8019323, 0), Point(-105.49982, 137.3651562, 0)])
file_path = FilePath("D:\毕业论文\VolumeGeneratorBasedOnGraph\VolumeGeneratorBasedOnGraph\测试文件夹\1024Test.csv")
# // 构造全局参数
globals = Globals(VolumeNodePoints=point, BoundaryNodePoints=point_2)
# // CSV读取
csvreader = CSVReader(GlobalParameter=globals, CSVFilePath=file_path)  # -> VolumeConnectivityTree, BoundaryAdjacencyTree, VolumeNodeAttributes
panel = Panel("""N1
W
S
E1
N2
E2""")
# // 构造图结构
constructgraph = ConstructGraph(
    GlobalParameter=globals,
    VolumeConnectivityTree=csvreader.VolumeConnectivityTree,
    BoundaryAdjacencyTree=csvreader.BoundaryAdjacencyTree,
    VolumeNodeAttributes=csvreader.VolumeNodeAttributes,
    BoundaryNodeLabels=panel)  # -> Graph, GraphNode
xy_plane = XYPlane(Origin=Point(0, 0, 0))
# // Tutte嵌入
tutteconvexdrawing = TutteConvexDrawing(GlobalParameter=globals, BasePlane=xy_plane, Graph=constructgraph.Graph, GraphNode=constructgraph.GraphNode)  # -> GraphNode, ConvexFaceBorders, SubGraph, SubGraphNode, GraphEdge
# // 三角剖分
triangulate = Triangulate(
    GlobalParameter=globals,
    GraphNode=tutteconvexdrawing.GraphNode,
    ConvexFaceBorders=tutteconvexdrawing.ConvexFaceBorders,
    IndexOfTriangularMesh=Slider(1, range=0..49),
    ExcludeDegenerateTINS=Toggle(True))  # -> AllTriangularMeshes, TheChosenTriangularMesh, TheChosenTriangleHalfedgeMesh, DebugVerticesOutput, DebugHalfedgesOutput, DebugFacesOutput
panel_2 = Panel(triangulate.DebugHalfedgesOutput)
panel_3 = Panel(triangulate.DebugFacesOutput)
panel_4 = Panel(triangulate.DebugVerticesOutput)
# // 生成剖分后的对偶图
ghcdualusinghalfedge = GhcDualUsingHalfedge(
    GlobalParameter=globals,
    TheChosenTriangleHalfedgeMesh=triangulate.TheChosenTriangleHalfedgeMesh,
    GraphNode=tutteconvexdrawing.GraphNode)  # -> DualHalfedgeMesh, DebugVerticesOutput, DebugHalfedgesOutput, DebugFacesOutput, FaceIndexsFromOuterNodes
dualgraph = DualGraph(GlobalParameter=globals, TriangleMesh=triangulate.TheChosenTriangularMesh, GraphNode=tutteconvexdrawing.GraphNode)  # -> DualVertices, DualFacesDescriptions, DualConvexPolygons, DualConvexConnectivityGraph, DualConvexCenterPointsAsGraphNodes
curve = Curve(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)
panel_5 = Panel(ghcdualusinghalfedge.DebugHalfedgesOutput)
panel_6 = Panel(ghcdualusinghalfedge.DebugVerticesOutput)
panel_7 = Panel(ghcdualusinghalfedge.DebugFacesOutput)
createboundarypoints = CreateBoundaryPoints(
    GlobalParameter=globals,
    BoundaryPolyline=curve,
    DualHalfedgeMesh=ghcdualusinghalfedge.DualHalfedgeMesh,
    FaceIndexsFromOuterNodes=ghcdualusinghalfedge.FaceIndexsFromOuterNodes,
    GraphNode=tutteconvexdrawing.GraphNode)
panel_8 = Panel(ghcdualusinghalfedge.FaceIndexsFromOuterNodes)
